% Simulink data dictionary DD_Mdl.sldd

BEMTPitchMax_deg = -30
BladeLength_m = 61.5
BladeMass_kg = 17740
BladePitchMax_deg = 0
BladePitchStart_deg = -85
BladePitchrateNorm_degpers = 3
BladePitchrateStop_degpers = 9
BladePrecone_deg = 2.5
BladeTwist_deg = [13.308 13.308 13.308 13.308 13.308 13.308 13.308 13.308 13.308 13.308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 0]
Cut_OffWindSpeed_mpers = 25
DownwashCorrection = 0.26
DownwashModelSwitch = 3
GeneratorEfficiency = 0.944
HubRadius_m = 1.5
Overhang_m = 5
RatedOmega_RPM = 12.1
RatedWindSpeed_mpers = 11.4
Shafttilt_deg = 5
TipSpeedLoss = 0
TowerDamOnperoff = 0
TowerDragCoefficient = 0.35
TowerRadius_m = 1.935
cperR = [0.054; 0.054; 0.056; 0.058; 0.06; 0.061; 0.063; 0.065; 0.067; 0.069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 0.017]
drperR = [0.024 0.003 0.016 0.016 0.016 0.016 0.016 0.016 0.016 0.016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 0.005]
g_mpers_2 = 9.81
mpermBl = [0.058 0.008 0.044 0.043 0.042 0.034 0.026 0.024 0.023 0.022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 0]
nBl = 3
nR = 49
rho_kgperm3 = 1.225
rperR = [0.024 0.027 0.043 0.059 0.075 0.09 0.106 0.122 0.138 0.154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 1]
DT_s = 0.008