% Simulink data dictionary DD_Mdl1.sldd

Rotor_Lambda = [0; 0.1; 0.2; 0.3; 0.4; 0.5; 0.6; 0.7; 0.8; 0.9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 14.9]
Rotor_Pitch = [-8; -7.8; -7.6; -7.4; -7.2; -7; -6.8; -6.6; -6.4; -6.2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 25]
rho = 1.225
tau_g = 0.01

wecs = struct(
  Ng=97,
  mh=56780,
  mb=17740,
  mn=240000,
  mtower=347460,
  mt=436865,
  H=87.6,
  Jrg=534.116,
  Jr=40469423.444,
  wnb=4.393831,
  wnt=2.035752,
  wntsw=1.960354,
  zetat=0.01,
  zetab=0.477465,
  Kt=1810494,
  Bt=17786.98,
  Ktsw=1678867,
  Btsw=17128.2,
  Kb=342484.1,
  Bb=74433.52,
  Ks=867637000,
  Bs=6215000,
  N=3,
  rb=63)

Drivetrain = struct(Generator=struct(Efficiency=0.944, HSSInertia=534.116), Gearbox=struct(Ratio=97, Efficiency=1))
Ng = 97
Ce = [17786.98 0 0 0; 0 8.862799e+08 0 0; 0 0 6215000 -6215000; 0 0 -6215000 6215000]
K = [1810494 0 0 0; 0 4.077958e+09 0 0; 0 0 867637000 -867637000; 0 0 -867637000 867637000]
M = [436865 3352860 0 0; 3352860 211230180 0 0; 0 0 40469423.444 0; 0 0 0 5025497.444]
Q = [1 0 0; 63 0 0; 0 1 0; 0 0 -97]