% Simulink data dictionary DD_test.sldd

slBus1 = Simulink.Bus()
  wind_mpers: double
  GenSpd_radpers: double
  RotSpd_radpers: double
  ydotdot_mpers2: double
  xdotdot_mpers2: double
  zetadotdot_mpers2: double
  ThetaS_rad: double
  GenPwr_kW: double
  GenTq_Nm: double
  Pitch_rad: double

DT = 0.008
betaLUT = [0 0.06419321 0.1125912 0.1492955 0.1808161 0.209265 0.2370157 0.2619739 0.2853613 0.3077015 0.3293436 0.3502876 0.3703589 0.389732 0.4085816]
lambdaCqVecLUT = [0 6.127062e-05 0.0001225412 0.0001838118 0.0002450825 0.0003063531 0.0003676237 0.0004288943 0.0004901649 0.0005514355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 0.005208002]

lambdaTildaMat = [14.41953 13.71939 13.01926 12.31912 11.61898 10.99178 10.48071 10.05318 9.686176 9.368757 9.088286 8.837096 8.610029 8.402044 8.211068 8.033677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
 14.3496 13.57436 12.79911 12.02387 11.27282 10.65138 10.13857 9.704569 9.33209 9.005547 8.716724 8.457599 8.223377 8.010141 7.814838 7.635974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
 12.13309 11.31338 10.6383 10.07717 9.600687 9.194495 8.844154 8.536089 8.263321 8.019973 7.80022 7.601112 7.419219 7.25169 7.095901 6.9523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
 9.9 9.259829 8.878195 8.551562 8.263746 8.004978 7.772176 7.558354 7.363885 7.186108 7.022563 6.871232 6.731502 6.600584 6.479062 6.364829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
 8.4 7.926811 7.676727 7.455953 7.262491 7.085748 6.924254 6.775261 6.63678 6.505642 6.382408 6.266604 6.157892 6.055523 5.958659 5.866778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
 7.3 6.982465 6.809716 6.652592 6.506807 6.373776 6.253161 6.141649 6.037313 5.939254 5.846265 5.757916 5.673565 5.592335 5.514843 5.441146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
 6.5 6.2259 6.108848 5.995204 5.888045 5.787376 5.692517 5.60359 5.520873 5.443626 5.370472 5.300506 5.235019 5.171464 5.110094 5.052012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
 5.8 5.653013 5.566209 5.483442 5.404275 5.327684 5.253893 5.182819 5.115292 5.051533 4.989831 4.932547 4.877316 4.824785 4.774355 4.725802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
 5.4 5.192137 5.125807 5.061808 4.999339 4.940805 4.883171 4.827604 4.773537 4.720951 4.670734 4.622086 4.575595 4.530898 4.487335 4.446311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
 4.9 4.818076 4.758923 4.706217 4.657277 4.608841 4.56295 4.517627 4.474023 4.431514 4.389756 4.350147 4.310539 4.273137 4.236536 4.19994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
 4.6 4.491079 4.446928 4.402777 4.362115 4.321687 4.282768 4.245595 4.208421 4.173444 4.13911 4.104776 4.072844 4.0413 4.009755 3.979847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
 4.3 4.227168 4.177297 4.141087 4.104877 4.071521 4.03861 4.005698 3.97519 3.945186 3.915181 3.886516 3.859223 3.831929 3.804636 3.779337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
 4.1 3.97873 3.945866 3.913002 3.882623 3.853869 3.825115 3.796709 3.770696 3.744683 3.718671 3.69334 3.669746 3.646152 3.622558 3.599072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
 3.9 3.775857 3.744792 3.713728 3.686186 3.661435 3.636683 3.611931 3.588429 3.566089 3.54375 3.52141 3.499165 3.479098 3.459031 3.438964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
 3.7 3.581811 3.55803 3.534249 3.510468 3.488228 3.467198 3.446168 3.425139 3.404109 3.384771 3.365844 3.346917 3.327989 3.309062 3.291267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 ]

sysEstTr = ss(
  a=[0.9949467 0.08890854 -0.0072788; -6.983809e-05 0.8288071 -9.748829e-05; 1.359704 -0.0260727 0.9673862],
  b=[5.649488e-10 0.007950293 -0.0006714922; 7.807752e-12 -6.89894e-07 9.817818e-05; -1.520121e-07 0.0152086 0.0174052],
  c=[1 0 0; 0 1 0; 0 0 1],
  d=[0 0 0; 0 1 0; 0 0 0],
  Ts=0.008)

sysMeasDel = ss(a=0.3678794, b=0.04045572, c=15.625, d=0, Ts=0.008)

slBus2 = Simulink.Bus()
  RefBlPitch1: double
  RefBlPitch2: double
  RefBlPitch3: double
  RefGenTq: double

wecs = struct(
  N=3,
  Ng=97,
  mh=56780,
  mbl=17740,
  mb=5913.333,
  mn=240000,
  mtower=347460,
  mt=436865,
  mtb=454605,
  H=90,
  Jg=534.116,
  Jr=35443926,
  wnb=4.393831,
  wnt=2.035752,
  wntsw=1.960354,
  zetat=0.01,
  zetab=0.00477465,
  Kt=1810494,
  Bt=17786.98,
  Ktsw=1678867,
  Btsw=17128.2,
  Kb=114161.4,
  Bb=248.1117,
  Ks=867637000,
  Bs=6215000,
  Rr=63,
  rb=58.59,
  etag=0.944)

Lin_points = struct(
  V=[4 5 6 7 8 9 10 11 12 13 14 15 16 17 18 19 20 21 22 23 24 25],
  Torque=[5.087 7.945 11.43 15.53 20.24 25.52 31.35 43.09 43.09 43.09 43.09 43.09 43.09 43.09 43.09 43.09 43.09 43.09 43.09 43.09 43.09 43.09],
  Pitch=[0 0 0 0 0 0 0 0 0.06419321 0.1125912 0.1492955 0.1808161 0.209265 0.2356194 0.2602286 0.2832669 0.3054326 0.3269002 0.3476696 0.3675663 0.386765 0.4056145],
  GSpeed=[46.70501 58.36032 70.00516 81.60811 93.14822 104.6046 115.9248 122.941 122.941 122.941 122.941 122.941 122.941 122.941 122.941 122.941 122.941 122.941 122.941 122.941 122.941 122.941],
  RSpeed=[0.4815014 0.6017197 0.7217286 0.8413185 0.9602802 1.078613 1.194852 1.267109 1.267109 1.267109 1.267109 1.267109 1.267109 1.267109 1.267109 1.267109 1.267109 1.267109 1.267109 1.267109 1.267109 1.267109],
  x_op={[0.04131; 0.0069; -0.0001995; 0.0001116; 2.877; 0.0005694; 0.7803; 0.963; 1.157; 0.4647; -0.08951; -0.2865; 0.003217; -0.01644; -0.02969; -2.198e-5; 0.003537; -4.211e-7; 3.26e-6; 0.4815; 1.787e-6; -0.05486; 0.1072; -0.05207; 0.05682; -0.2113; 0.1543; 0.003721; -0.009198; 0.005475], [0.07334; 0.008976; -0.0001339; 0.0001724; 1.242; 0.0008886; 1.562; 1.213; 1.521; -0.1014; 0.4842; -0.2589; -0.02869; -0.0005194; -0.03006; 5.968e-5; 0.004033; 7.658e-7; 3.666e-6; 0.6017; 1.77e-6; -0.1076; -0.01628; 0.123; 0.2565; -0.05234; -0.2044; 0.01028; -0.0004523; -0.009816], [0.1125; 0.01134; -5.271e-5; 0.0002463; 0.01409; 0.001278; 2.191; 1.94; 1.813; -0.3964; 0.286; 0.2756; -0.04587; -0.01958; -0.01463; 0.000354; 0.003978; 2.567e-7; 3.976e-6; 0.7217; 1.459e-6; 0.05373; -0.1576; 0.1023; 0.007863; 0.279; -0.2871; -0.002074; 0.01306; -0.01099], [0.1587; 0.01397; 3.739e-5; 0.0003332; 5.199; 0.001736; 2.62; 2.792; 2.408; -0.1422; -0.1684; 0.5222; -0.04131; -0.04833; -0.01609; -7.696e-5; 0.002736; -7.288e-7; 1.906e-6; 0.8413; 7.965e-7; 0.1875; -0.1036; -0.08092; -0.3383; 0.3212; 0.0171; -0.01568; 0.01226; 0.003392], [0.211; 0.01821; 0.0001457; 0.0004334; 4.106; 0.002261; 3.097; 3.474; 3.309; 0.3478; -0.364; 0.2778; -0.03148; -0.06454; -0.0404; -4.695e-5; -0.001331; 3.646e-6; -1.011e-6; 0.9603; -1.677e-6; 0.08895; 0.1207; -0.214; -0.3575; -0.03384; 0.3913; -0.01333; -0.004979; 0.0184], [0.2698; 0.02646; 0.000259; 0.0005498; 2.939; 0.002853; 3.882; 3.961; 4.244; 0.5476; -0.0382; -0.1956; -0.03895; -0.06004; -0.07344; 0.0002492; -0.005957; -6.89e-6; -6.088e-6; 1.078; -2.594e-6; -0.1679; 0.2179; -0.04473; 0.1036; -0.4659; 0.3628; 0.008205; -0.02128; 0.01306], [0.334; 0.03532; 0.000387; 0.0006769; 1.607; 0.003507; 4.95; 4.592; 4.861; 0.1364; 0.5101; -0.2794; -0.07471; -0.05235; -0.08691; -0.0002663; -0.00161; 1.117e-5; -1.748e-6; 1.195; 3.238e-7; -0.1954; -0.05049; 0.2446; 0.5376; -0.2843; -0.2531; 0.02413; -0.008685; -0.01559], [0.3956; 0.04239; 0.0005191; 0.0008446; 6.234; 0.004372; 5.623; 5.576; 5.281; -0.3273; 0.3278; 0.3767; -0.1053; -0.07984; -0.07086; -0.0004511; -0.004996; 9.319e-6; 2.864e-6; 1.267; -0.0001925; 0.2239; -0.2734; 0.03724; -0.03051; 0.5082; -0.4833; -0.006785; 0.02542; -0.01891], [0.3341; 0.04564; 0.0004002; 0.0009247; 0.03745; 0.004794; 4.769; 4.535; 4.324; -0.2975; 0.3902; 0.3606; -0.1037; -0.07077; -0.06565; -0.0001543; -0.003804; 6.322e-6; -4.17e-6; 1.267; 7.019e-5; 0.15; -0.3282; 0.1772; 0.02945; 0.4777; -0.5066; -0.003579; 0.02777; -0.02422], [0.2859; 0.04669; 0.0003027; 0.0009276; 0.04602; 0.004823; 4.053; 3.745; 3.563; -0.2841; 0.4024; 0.3601; -0.1014; -0.06454; -0.06058; 2.558e-5; -0.00451; 7.431e-6; 7.383e-5; 1.267; 0.0001253; 0.1301; -0.3542; 0.239; 0.02541; 0.4547; -0.5177; -0.00404; 0.02835; -0.02873], [0.2553; 0.04794; 0.0002407; 0.0009237; 0.04362; 0.004787; 3.557; 3.211; 3.04; -0.2781; 0.403; 0.3589; -0.101; -0.0615; -0.05805; 0.0002174; -0.003918; 3.983e-7; -5.044e-5; 1.268; -0.0003327; 0.114; -0.3819; 0.2602; 0.04609; 0.4675; -0.4962; -0.001135; 0.033; -0.028], [0.2328; 0.04771; 0.0001945; 0.0009218; 0.03723; 0.004792; 3.157; 2.792; 2.623; -0.2774; 0.3969; 0.3555; -0.1015; -0.06024; -0.05689; 0.0001957; -0.003255; 7.142e-6; 3.87e-6; 1.268; -0.0002483; 0.1135; -0.3894; 0.2785; 0.03644; 0.4572; -0.4976; -0.002376; 0.03275; -0.03073], [0.2151; 0.04768; 0.0001593; 0.0009185; 0.03189; 0.004779; 2.818; 2.438; 2.272; -0.2782; 0.3896; 0.3506; -0.1025; -0.05975; -0.05646; 0.000359; -0.003616; 1.113e-5; 1.438e-6; 1.267; 0.0002154; 0.1098; -0.3965; 0.2898; 0.03604; 0.4551; -0.4911; -0.001923; 0.03408; -0.03136], [0.2007; 0.04739; 0.0001317; 0.0009133; 0.02975; 0.004763; 2.513; 2.132; 1.971; -0.2804; 0.3824; 0.3438; -0.104; -0.0598; -0.05677; 0.0003789; -0.0036; 1.436e-5; -5.774e-6; 1.267; 0.0001856; 0.1087; -0.3982; 0.2954; 0.03509; 0.4506; -0.4879; -0.001506; 0.035; -0.0324], [0.1886; 0.0469; 0.000109; 0.0009056; 0.02615; 0.004736; 2.222; 1.856; 1.698; -0.2836; 0.3741; 0.3371; -0.1059; -0.06046; -0.05768; 0.000544; -0.003864; 1.702e-5; -2.398e-5; 1.267; -0.0002259; 0.1022; -0.3877; 0.286; 0.0361; 0.4499; -0.4818; -0.001857; 0.03554; -0.03365], [0.1787; 0.04624; 9.25e-5; 0.0009014; 0.0231; 0.004712; 1.964; 1.601; 1.451; -0.2877; 0.3645; 0.3294; -0.1077; -0.06181; -0.05909; 0.0008378; -0.004948; 1.187e-5; -1.719e-5; 1.267; 7.566e-5; 0.09429; -0.3697; 0.2789; 0.03389; 0.4465; -0.4776; -0.001482; 0.03673; -0.03375], [0.1705; 0.04558; 7.926e-5; 0.000893; 0.02052; 0.004681; 1.738; 1.366; 1.226; -0.2905; 0.356; 0.3225; -0.1092; -0.06326; -0.06051; 0.001178; -0.005734; 1.022e-5; -5.116e-6; 1.267; -0.0001788; 0.08555; -0.3642; 0.2793; 0.03194; 0.4429; -0.474; -0.002084; 0.03637; -0.03451], [0.1635; 0.0447; 6.88e-5; 0.0008854; 0.01793; 0.004654; 1.525; 1.155; 1.024; -0.2944; 0.3466; 0.315; -0.1109; -0.06464; -0.06185; 0.001171; -0.005888; 1.703e-5; 6.773e-6; 1.267; -1.033e-5; 0.07653; -0.3624; 0.2823; 0.03287; 0.4418; -0.466; -0.001506; 0.03663; -0.03475], [0.1572; 0.04437; 6.125e-5; 0.0008803; 0.01484; 0.004635; 1.307; 0.9616; 0.8413; -0.2997; 0.337; 0.3075; -0.1132; -0.06609; -0.06345; 0.001236; -0.006319; 2.168e-5; 1.129e-5; 1.267; -0.0001963; 0.06678; -0.3408; 0.2792; 0.02768; 0.4363; -0.4656; -0.001538; 0.03678; -0.03546], [0.152; 0.04358; 5.725e-5; 0.000871; 0.0115; 0.004598; 1.089; 0.7739; 0.6698; -0.3056; 0.3271; 0.3004; -0.1157; -0.06802; -0.06556; 0.001352; -0.006508; 2.524e-5; -4.907e-6; 1.267; 0.000107; 0.04932; -0.3041; 0.2608; 0.02479; 0.4345; -0.4622; -0.001169; 0.03747; -0.03551], [0.1473; 0.04297; 5.618e-5; 0.0008616; 0.009086; 0.004567; 0.8786; 0.5881; 0.5067; -0.3123; 0.3165; 0.2923; -0.1182; -0.07041; -0.06808; 0.001499; -0.006749; 2.975e-5; 2.093e-5; 1.267; -0.0002316; 0.03511; -0.2624; 0.2409; 0.02029; 0.4315; -0.4612; -0.001698; 0.03683; -0.03665], [0.1431; 0.0426; 5.567e-5; 0.0008521; 0.0076; 0.004524; 0.6794; 0.4069; 0.3492; -0.3188; 0.3064; 0.2837; -0.1204; -0.0729; -0.07073; 0.001364; -0.005829; 2.768e-5; -1.519e-5; 1.267; 6.889e-5; 0.02011; -0.2305; 0.2204; 0.02097; 0.432; -0.4578; -0.001578; 0.03684; -0.03662]},
  y_op={[4; 0; 0; 224.3; 5.087; 0.8554; 0.9236; 1.07; 0.3639; -0.2084; -0.4287; 0.0001556; 0.006959; 2.183e-5; 1775; 1575; 1864; -3300; 1075; 2697; 1775; 1575; 1864; -3300; 1075; 2697; 739.6; 7383; -30.99; 120.2; -496.1; 4.598; 446; 0; 254.9; 237.9; 191.1; 4.598; 5.093], [5; 0; 0; 437.7; 7.945; 1.503; 1.284; 1.434; -0.2951; 0.3298; -0.4458; 0.0006229; 0.003456; 9.131e-5; 2700; 2480; 2391; 1410; -3282; 2609; 2700; 2480; 2391; 1410; -3282; 2609; 866.6; 12350; -58.93; 499.7; 157.7; 5.746; 557.3; 0; 161.2; 463.9; 245.8; 5.746; 7.949], [6; 0; 0; 755.4; 11.43; 2.06; 1.953; 1.83; -0.6658; 0.04247; 0.04853; 0.0009319; -0.001303; 0.0001337; 3476; 3632; 3286; 3949; -1467; -1422; 3476; 3632; 3286; 3949; -1467; -1422; 995.2; 18420; -91.81; 19.13; 535.1; 6.892; 668.5; 0; 90.88; 800.1; 312.5; 6.892; 11.43], [7; 0; 0; 1197; 15.53; 2.533; 2.692; 2.461; -0.4666; -0.5144; 0.219; -0.0008483; -0.007987; -0.0001125; 4350; 4748; 4558; 2144; 2412; -3117; 4350; 4748; 4558; 2144; 2412; -3117; 1119; 25610; -137.3; -507.2; 272.1; 8.034; 779.3; 0; 27.96; 1267; 391.3; 8.034; 15.53], [8; 0; 0; 1779; 20.24; 3.099; 3.319; 3.288; -0.0396; -0.7932; -0.1359; 0.000682; -0.01004; 8.155e-5; 5566; 5731; 5999; -1469; 4214; -870.7; 5566; 5731; 5999; -1469; 4214; -870.7; 1459; 33710; -208.1; -475.5; -359.5; 9.17; 889.5; 0; 325.4; 1884; 480.8; 9.17; 20.23], [9; 0; 0; 2520; 25.52; 3.904; 3.862; 4.102; 0.0606; -0.5304; -0.7224; -0.0006126; 0.001331; -6.727e-5; 7175; 6800; 7296; -2734; 1889; 3209; 7175; 6800; 7296; -2734; 1889; 3209; 2398; 42850; -268.7; 170.3; -633.9; 10.3; 998.9; 0; 258.6; 2670; 581.1; 10.3; 25.52], [10; 0; 0; 3432; 31.35; 4.857; 4.588; 4.686; -0.4811; -0.065; -0.8824; 0.0001878; 0.01364; 4.761e-5; 8849; 8386; 8293; 891.7; -2128; 4139; 8849; 8386; 8293; 891.7; -2128; 4139; 3405; 52830; -385.7; 708.2; 79.63; 11.41; 1107; 0; 182.3; 3637; 691.3; 11.41; 31.37], [11; 0; 0; 5000; 43.09; 5.415; 5.505; 5.229; -1.026; -0.3694; -0.2836; 0.001024; 0.009517; 0.000152; 9707; 10140; 9542; 4805; -375.1; -811.6; 9707; 10140; 9542; 4805; -375.1; -811.6; 3969; 62360; -464.8; -150.3; 701.6; 12.1; 1174; 0; 87.44; 4804; 796; 12.1; 39.09], [12; 0; 0; 5001; 43.09; 4.508; 4.471; 4.262; -1.183; -0.4671; -0.4564; 0.0005214; 0.004994; 8.721e-5; 8263; 8629; 8110; 4933; -557.1; -407.1; 8563; 8576; 8067; 4393; -1109; -926.5; 4223; 52800; -510; -106.2; 647.6; 12.1; 1174; 3.678; 92.42; 5272; 690.3; 12.1; 42.89], [13; 0; 0; 5000; 43.09; 3.755; 3.684; 3.5; -1.22; -0.4869; -0.4851; 0.0003445; 0.006549; 1.335e-5; 7064; 7472; 6989; 4929; -585.1; -357.3; 7573; 7359; 6904; 4104; -1421; -1140; 4386; 45310; -574; -166.3; 627.4; 12.1; 1174; 6.451; 92.91; 5304; 607.8; 12.1; 43.14], [14; 0; 0; 5002; 43.09; 3.232; 3.154; 2.978; -1.219; -0.4781; -0.474; 0.001155; 0.01489; 7.336e-5; 6254; 6719; 6253; 4903; -590.4; -363.3; 6914; 6557; 6129; 3918; -1583; -1289; 4597; 40560; -633.7; -234.3; 620.1; 12.1; 1174; 8.554; 92.77; 5260; 555.8; 12.1; 42.79], [15; 0; 0; 5002; 43.09; 2.81; 2.736; 2.564; -1.2; -0.4579; -0.4465; 0.001505; 0.01295; 0.000192; 5612; 6145; 5690; 4887; -564.8; -373.8; 6400; 5943; 5530; 3798; -1661; -1391; 4569; 37070; -706; -311.3; 615.5; 12.1; 1174; 10.36; 92.41; 5267; 517.4; 12.1; 42.85], [16; 0; 0; 5000; 43.09; 2.453; 2.385; 2.217; -1.17; -0.427; -0.4097; 0.001572; 0.01207; 0.0001963; 5077; 5675; 5231; 4862; -545.4; -383.8; 5976; 5438; 5038; 3701; -1712; -1462; 4579; 34320; -777; -386.8; 609.3; 12.1; 1174; 11.99; 92.1; 5257; 487.1; 12.1; 42.76], [17; 0; 0; 5000; 43.09; 2.133; 2.083; 1.921; -1.129; -0.389; -0.3685; 0.002228; 0.01126; 0.0003237; 4608; 5283; 4850; 4831; -534.5; -383.8; 5608; 5013; 4627; 3622; -1753; -1505; 4550; 32090; -859.3; -472.9; 602.9; 12.1; 1174; 13.5; 91.98; 5239; 462.6; 12.1; 42.62], [18; 0; 0; 5001; 43.09; 1.832; 1.813; 1.654; -1.075; -0.3449; -0.3198; 0.002691; 0.01138; 0.0004264; 4174; 4942; 4520; 4789; -520.9; -389.7; 5266; 4641; 4268; 3554; -1775; -1540; 4494; 30200; -955.1; -575.4; 594.8; 12.1; 1174; 14.91; 91.77; 5205; 441.6; 12.1; 42.34], [19; 0; 0; 5000; 43.09; 1.565; 1.565; 1.414; -1.019; -0.2945; -0.2671; 0.002007; 0.009195; 0.0002415; 3791; 4636; 4232; 4749; -505.8; -390.7; 4968; 4310; 3954; 3500; -1782; -1558; 4400; 28660; -1041; -665.1; 581.2; 12.1; 1174; 16.23; 91.59; 5182; 424.2; 12.1; 42.15], [20; 0; 0; 5001; 43.09; 1.334; 1.338; 1.199; -0.9616; -0.2387; -0.2111; 0.001888; 0.008514; 0.0002674; 3459; 4365; 3979; 4707; -497.4; -393.6; 4714; 4013; 3677; 3449; -1787; -1572; 4318; 27360; -1108; -738.2; 565.7; 12.1; 1174; 17.5; 91.44; 5146; 409.6; 12.1; 41.86], [21; 0; 0; 5001; 43.09; 1.117; 1.137; 1.007; -0.9004; -0.1837; -0.1555; 0.001338; 0.004929; 0.0001912; 3148; 4124; 3756; 4662; -483.8; -393.2; 4478; 3750; 3431; 3404; -1782; -1579; 4205; 26260; -1187; -820.7; 550.6; 12.1; 1174; 18.73; 91.29; 5117; 396.9; 12.1; 41.62], [22; 0; 0; 5001; 43.09; 0.8993; 0.9544; 0.8353; -0.829; -0.1279; -0.09956; 0.0008973; 0.005723; 7.359e-5; 2840; 3907; 3561; 4612; -466.1; -387.4; 4241; 3514; 3216; 3369; -1769; -1577; 4165; 25280; -1288; -926.8; 531.5; 12.1; 1174; 19.92; 91.12; 5095; 385.6; 12.1; 41.45], [23; 0; 0; 5000; 43.09; 0.684; 0.7789; 0.6759; -0.7483; -0.0666; -0.0412; 0.0005319; 0.00288; 7.485e-5; 2542; 3704; 3390; 4553; -451.4; -381.5; 4008; 3295; 3027; 3335; -1752; -1574; 4071; 24440; -1400; -1043; 502.6; 12.1; 1174; 21.06; 90.92; 5056; 375.6; 12.1; 41.13], [24; 0; 0; 5001; 43.09; 0.48; 0.6072; 0.5257; -0.6641; 0.0006126; 0.01903; 0.0002271; 0.002232; 4.058e-5; 2258; 3510; 3234; 4491; -439.9; -369.2; 3785; 3085; 2855; 3308; -1732; -1562; 4002; 23700; -1506; -1156; 468.2; 12.1; 1174; 22.16; 90.78; 5020; 366.7; 12.1; 40.84], [25; 0; 0; 5000; 43.09; 0.2897; 0.4425; 0.3825; -0.5775; 0.07271; 0.0821; 0.000399; 0.00228; 0.000143; 1989; 3326; 3085; 4426; -434.5; -354.5; 3573; 2884; 2695; 3283; -1711; -1543; 3975; 23010; -1607; -1262; 435; 12.1; 1174; 23.24; 90.69; 4975; 358.4; 12.1; 40.47]},
  u_op={[4; 0; 0; 0; 0; 0; 0; 5087; 0], [5; 0; 0; 0; 0; 0; 0; 7945; 0], [6; 0; 0; 0; 0; 0; 0; 11430; 0], [7; 0; 0; 0; 0; 0; 0; 15530; 0], [8; 0; 0; 0; 0; 0; 0; 20240; 0], [9; 0; 0; 0; 0; 0; 0; 25520; 0], [10; 0; 0; 0; 0; 0; 0; 31350; 0], [11; 0; 0; 0; 0; 0; 0; 43090; 0], [12; 0; 0; 0.06419; 0.06419; 0.06419; 0; 43090; 0.06419], [13; 0; 0; 0.1126; 0.1126; 0.1126; 0; 43090; 0.1126], [14; 0; 0; 0.1493; 0.1493; 0.1493; 0; 43090; 0.1493], [15; 0; 0; 0.1808; 0.1808; 0.1808; 0; 43090; 0.1808], [16; 0; 0; 0.2093; 0.2093; 0.2093; 0; 43090; 0.2093], [17; 0; 0; 0.2356; 0.2356; 0.2356; 0; 43090; 0.2356], [18; 0; 0; 0.2602; 0.2602; 0.2602; 0; 43090; 0.2602], [19; 0; 0; 0.2833; 0.2833; 0.2833; 0; 43090; 0.2833], [20; 0; 0; 0.3055; 0.3055; 0.3055; 0; 43090; 0.3055], [21; 0; 0; 0.3269; 0.3269; 0.3269; 0; 43090; 0.3269], [22; 0; 0; 0.3476; 0.3476; 0.3476; 0; 43090; 0.3476], [23; 0; 0; 0.3676; 0.3676; 0.3676; 0; 43090; 0.3676], [24; 0; 0; 0.3868; 0.3868; 0.3868; 0; 43090; 0.3868], [25; 0; 0; 0.4055; 0.4055; 0.4055; 0; 43090; 0.4055]})